# Grasshopper definition somefuturetree_v2.1.ghx (Grasshopper 1.0.8)
# plug-ins: Karamba3D, Human, NGon_RH8

unit_z = UnitZ(Factor=Slider(5.5, range=0..10))

curve = Curve(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)
curve_2 = Curve(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)

cluster = Cluster_3(curve=curve_2)  # -> i, curve_2
python_3_script = Python3Script(crv1=cluster.i, crv2=cluster.curve_2)  # -> out, networks, networks_shifted; inputs crv1: list of Curve, crv2: list of Curve
# ---------- python_3_script: Python ----------
from compas_rhino.conversions import curve_to_compas
from compas.geometry import NurbsCurve, Line

# Inputs
networks = []
networks_shifted = []

n1 = 12   # base columns
nr = 8   # base rows 
start_odd_x = False  

# Network 1 Parameters (Larger, less dense)
nx = n1 * 2  
ny = nr  

# Network 2 Parameters (Smaller, twice as divided)
nx2 = nx * 2
ny2 = ny * 2

# The shift: Centroid is 1/3 of the height of the smaller triangle from its corner
# We use this same absolute distance to shift the larger network
v_shift = (2.0 / ny2) / 3.0

for c1_rhino, c2_rhino in zip(crv1, crv2):
    c1 = curve_to_compas(c1_rhino)
    c2 = curve_to_compas(c2_rhino)

    edge_start = NurbsCurve.from_line(Line(c1.start, c2.start))
    edge_end   = NurbsCurve.from_line(Line(c1.end,   c2.end))

    # ==========================================
    # --- 1. SMALLER NETWORK (Fixed, Original Bounds) ---
    # ==========================================
    grid2 = []
    for r in range(ny2 + 1):
        v2 = r / ny2
        
        row_start_pt2 = edge_start.point_at(v2)
        row_end_pt2   = edge_end.point_at(v2)
        rowline2 = NurbsCurve.from_line(Line(row_start_pt2, row_end_pt2))

        _, row2 = rowline2.divide_by_count(nx2, True)
        grid2.append(row2)
            
    network2 = []
    for j in range(ny2 + 1):
        if start_odd_x:
            start_idx2 = 1 if j % 2 == 0 else 0
        else:
            start_idx2 = 0 if j % 2 == 0 else 1
            
        # Diagonals
        if j < ny2:
            for i in range(start_idx2, nx2 + 1, 2):
                curr = grid2[j][i]
                if i - 1 >= 0:
                    network2.append(Line(curr, grid2[j+1][i-1]))
                if i + 1 <= nx2:
                    network2.append(Line(curr, grid2[j+1][i+1]))

        # Horizontals
        for i in range(start_idx2, nx2 - 1, 2):
            network2.append(Line(grid2[j][i], grid2[j][i+2]))

    networks.extend(network2) # Assuming you might want to swap list assignments if needed, 
                              # but keeping variable names logically consistent here.


    # ==========================================
    # --- 2. LARGER NETWORK (Shifted & Clamped) ---
    # ==========================================
    grid = []
    # Using range(-1, ny + 1) generates the out-of-bounds rows we need to clamp
    for r in range(-1, ny + 1):
        # Calculate shifted V, and clamp to the 0.0 to 1.0 bounds
        v_raw = (r / ny) + v_shift
        v = max(0.0, min(1.0, v_raw))
        
        row_start_pt = edge_start.point_at(v)
        row_end_pt   = edge_end.point_at(v)
        rowline = NurbsCurve.from_line(Line(row_start_pt, row_end_pt))

        _, row = rowline.divide_by_count(nx, True)
        grid.append(row)
            
    network = []
    for j in range(len(grid)):
        
        # Adjust parity so alternating pattern syncs with the r=-1 start
        effective_r = j - 1
        if start_odd_x:
            start_idx = 1 if effective_r % 2 == 0 else 0
        else:
            start_idx = 0 if effective_r % 2 == 0 else 1
            
        # Diagonals 
        if j < len(grid) - 1:
            for i in range(start_idx, nx + 1, 2):
                curr = grid[j][i]
                if i - 1 >= 0:
                    network.append(Line(curr, grid[j+1][i-1]))
                if i + 1 <= nx:
                    network.append(Line(curr, grid[j+1][i+1]))

        # Horizontals
        for i in range(start_idx, nx - 1, 2):
            network.append(Line(grid[j][i], grid[j][i+2]))

    networks_shifted.extend(network)
# ---------- end python_3_script ----------
compas_draw = COMPASDraw(cg=python_3_script.networks)  # -> rg
#   port cg: The COMPAS geometry or datastructure to be drawn.
#   port rg: The Rhino geometry object.
# ---------- compas_draw: Python ----------
# r: compas>=2.14.1
"""
Draws COMPAS geometry in Grasshopper.
"""

from typing import Any

import Grasshopper

from compas.scene import SceneObject


class CompasToRhinoGeometry(Grasshopper.Kernel.GH_ScriptInstance):
    def RunScript(self, cg):
        if not cg:
            return None

        return SceneObject(item=cg).draw()
# ---------- end compas_draw ----------
compas_draw_2 = COMPASDraw(cg=python_3_script.networks_shifted)  # -> rg; same code as compas_draw

cluster_2 = Cluster_2(list=compas_draw, curve=curve)
curve_3 = Curve([curve, curve_2, cluster_2])
curve_4 = Curve([compas_draw_2, curve_2])
explode = Explode(Curve=curve_3, Recursive=True)  # -> flatten(Segments), Vertices
explode_2 = Explode(Curve=curve_4, Recursive=True)  # -> flatten(Segments), Vertices
line_line_intersection_karamba3d = LLInter(IntersectingLines=explode.Segments, LinesToIntersect=explode.Segments, LimitDistance_m=0.005)  # -> InterSecPoints, flatten(LineSubSegments)
line_line_intersection_karamba3d_2 = LLInter(IntersectingLines=explode_2.Segments, LinesToIntersect=explode_2.Segments, LimitDistance_m=0.005)  # -> InterSecPoints, flatten(LineSubSegments)

python_3_script_2 = Python3Script(lines=line_line_intersection_karamba3d.LineSubSegments)  # -> out, dual, mesh; inputs lines: list of Line
# ---------- python_3_script_2: Python ----------
from compas.datastructures import Network, Mesh
from compas.geometry import dot_vectors, Vector

from compas_rhino.conversions import line_to_compas

lines = [line_to_compas(line) for line in lines]
mesh = Mesh.from_lines(lines, delete_boundary_face=True)

faces_to_delete = []
for fkey in mesh.faces():
    if len(mesh.face_vertices(fkey)) > 5:
        faces_to_delete.append(fkey)
    

for fkey in faces_to_delete:
    mesh.delete_face(fkey)

# Remove any orphaned vertices left behind by delete_face
mesh.remove_unused_vertices()
mesh.weld()


# Triangulate
for fkey in list(mesh.faces()):
    verts = mesh.face_vertices(fkey)
    if len(verts) == 4:
        # Quad → 2 triangles via diagonal
        p0 = mesh.vertex_coordinates(verts[0])
        p2 = mesh.vertex_coordinates(verts[2])
        if -0.1 < dot_vectors(Vector.from_start_end(p0, p2), Vector.Xaxis()) < 0.1:
            mesh.split_face(fkey, verts[1], verts[3])
        else:
            mesh.split_face(fkey, verts[0], verts[2])
    elif len(verts) > 4:
        # N-gon → fan triangulation from first vertex
        mesh.insert_vertex(fkey)

# for fkey in list(mesh.faces()):
#     mesh.face_attributes(fkey)["xi"] = 0.5

all_naked_vertices = []


# for u, v in mesh.edges():
#     # If the edge doesn't have a neighbor on both sides, it's a hole or boundary
#     if mesh.is_edge_on_boundary([u, v]):
#         all_naked_vertices.extend([u, v])

# # fixed_keys = list(set(all_naked_vertices))

# mesh.smooth_area(fixed=fixed_keys, kmax=10, damping=0.1, callback=None, callback_args=None)
# ---------- end python_3_script_2 ----------
compas_draw_3 = COMPASDraw(cg=python_3_script_2.mesh)  # -> rg; same code as compas_draw

mesh_edges = MeshEdges(Mesh=compas_draw_3)  # -> AllE, NakedE
python_3_script_3 = Python3Script(lines=line_line_intersection_karamba3d_2.LineSubSegments)  # -> out, dual, mesh; inputs lines: list of Line
# ---------- python_3_script_3: Python ----------
from compas.datastructures import Network, Mesh
from compas.geometry import dot_vectors, Vector

from compas_rhino.conversions import line_to_compas

lines = [line_to_compas(line) for line in lines]
mesh = Mesh.from_lines(lines, delete_boundary_face=True)

faces_to_delete = []
for fkey in mesh.faces():
    if len(mesh.face_vertices(fkey)) > 5:
        faces_to_delete.append(fkey)
    

for fkey in faces_to_delete:
    mesh.delete_face(fkey)

# Remove any orphaned vertices left behind by delete_face
mesh.remove_unused_vertices()
mesh.weld()


# Triangulate
for fkey in list(mesh.faces()):
    verts = mesh.face_vertices(fkey)
    if len(verts) == 4:
        # Quad → 2 triangles via diagonal
        p0 = mesh.vertex_coordinates(verts[0])
        p2 = mesh.vertex_coordinates(verts[2])
        if -0.1 < dot_vectors(Vector.from_start_end(p0, p2), Vector.Xaxis()) < 0.1:
            mesh.split_face(fkey, verts[1], verts[3])
        else:
            mesh.split_face(fkey, verts[0], verts[2])
    elif len(verts) > 4:
        # N-gon → fan triangulation from first vertex
        mesh.insert_vertex(fkey)


all_naked_vertices = []
# ---------- end python_3_script_3 ----------
join_curves = JoinCurves(Curves=mesh_edges.NakedE, Preserve=False)

compas_draw_4 = COMPASDraw(cg=python_3_script_3.mesh)  # -> rg; same code as compas_draw
weld_mesh = WeldMesh(Mesh=compas_draw_4, Angle=3.141592654)

area = Area(Geometry=join_curves)  # -> Area, Centroid
sort_list = SortList(Keys=area.Area, ValuesValuesA=join_curves)  # -> Keys, reverse(ValuesValuesA)
split_list = SplitList(List=sort_list.ValuesValuesA, Index=Slider(1, range=0..100))  # -> ListA, ListB

curve_5 = Curve(split_list.ListB)
curve_6 = Curve(split_list.ListA)

mesh = Mesh(compas_draw_3)

deconstruct_mesh = DeconstructMesh(Mesh=mesh)  # -> Vertices, Faces, Colours, Normals
deconstruct = Deconstruct(Point=deconstruct_mesh.Vertices)  # -> XComponent, YComponent, ZComponent
construct_point = ConstructPoint(XCoordinate=deconstruct.XComponent, YCoordinate=deconstruct.YComponent, ZCoordinate=Slider(6, range=0..10))
anchor = Anchor(Point=deconstruct_mesh.Vertices, Target=construct_point, Strength=Slider(10, range=0..10))

point = Point([Point(86.52430207, 9.620222865, 0), Point(86.52430207, 19.24022287, 0), Point(48.04430207, 9.620222865, 0), Point(48.04430207, 19.24022287, 0)])
number_slider = Slider(1000, range=0..1000)
distance = Distance(PointA=graft(point), PointB=deconstruct_mesh.Vertices)
sort_list_2 = SortList(Keys=distance, ValuesValuesA=deconstruct_mesh.Vertices)  # -> Keys, ValuesValuesA
explode_3 = Explode(Curve=curve_5, Recursive=invert(True))  # -> Segments, flatten(Vertices)
list_item = ListItem(List=sort_list_2.ValuesValuesA, Index=0, Wrap=True)  # -> Item, Item1
point_2 = Point(flatten([list_item.Item, list_item.Item1]))
anchorxyz = AnchorXYZ(Point=point_2, X=invert(False), Y=invert(False), Z=invert(False), Strength=number_slider)
anchorxyz_2 = AnchorXYZ(Point=explode_3.Vertices, X=invert(False), Y=invert(False), Z=invert(False), Strength=Slider(600, range=0..1000))

explode_4 = Explode(Curve=curve_6, Recursive=True)  # -> Segments, flatten(Vertices)
deconstruct_2 = Deconstruct(Point=explode_4.Vertices)  # -> XComponent, YComponent, ZComponent
construct_point_2 = ConstructPoint(XCoordinate=deconstruct_2.XComponent, YCoordinate=deconstruct_2.YComponent, ZCoordinate=Slider(5, range=0..10))
anchor_2 = Anchor(Point=explode_4.Vertices, Target=construct_point_2, Strength=number_slider)

smooth = Smooth(M=mesh, Strength=Slider(900, range=0..1000))

show = Show(G=mesh)

move = Move(Geometry=weld_mesh, Motion=unit_z)  # -> Geometry, Transform

merge = Merge(Data1=show, Data2=anchorxyz, Data3=anchorxyz_2, Data4=anchor, Data5=smooth, Data6=anchor_2)  # -> flatten(Result)

solver = Solver(GoalObjects=merge, Reset=Button(), Threshold=Slider(0.0001, range=0..0.0001), Tolerance=0.0001, On=Toggle(True))  # -> I, V, O

cluster_3 = Cluster(tree=solver.O)
mesh_2 = Mesh(move.Geometry)
python_3_script_4 = Python3Script(mesh=mesh_2)  # -> out, lines, beam_pairs
# ---------- python_3_script_4: Python ----------
import os
import sys
import Rhino.Geometry as rg
import rhinoscriptsyntax as rs

_gh_path = ghenv.Component.OnPingDocument().FilePath
_gh_dir = os.path.dirname(_gh_path)
_this_dir = os.path.join(_gh_dir, "reciprocal_from_mesh")

if _this_dir not in sys.path:
    sys.path.insert(0, _gh_dir)
    sys.path.insert(0, _this_dir)

import importlib
import core_graph
importlib.reload(core_graph)

from core_graph import ReciprocalFrame
from compas_rhino.conversions import mesh_to_compas
from compas.itertools import remap_values

# ============ GRASSHOPPER MAIN ============

if 'mesh' in dir() and mesh:
    if mesh:
        rhino_geo = rs.coercemesh(mesh)
        if isinstance(rhino_geo, rg.Mesh):
            mesh = mesh_to_compas(rhino_geo)
        else:
            mesh = mesh
    
    fc = [mesh.face_centroid(fkey).z for fkey in mesh.faces()]

    max_fc = max(fc)
    # Fix xi here:
    for fkey in list(mesh.faces()):
        mesh.face_attributes(fkey)["xi"] = 0.3

    wt, we, wf, ws = 1.0, 0.3, 0.1, 0.0
    rf = ReciprocalFrame.from_mesh(mesh)  # Build graph only
    solver_info = rf.solve(weights=(wt, we, wf, ws))  # Then solve

    lines = rf.to_lines()

print(solver_info)

beam_pairs = []
for u, v in rf.edges():
    # Get the COMPAS Line object for each beam in the connection
    beam1 = rf.get_beam(u)
    beam2 = rf.get_beam(v)
    
    beam_pairs.append([beam1, beam2])

from ghpythonlib.treehelpers import list_to_tree

beam_pairs = list_to_tree(beam_pairs)
# ---------- end python_3_script_4 ----------
mesh_edges_2 = MeshEdges(Mesh=mesh_2)  # -> AllE, NakedE
python_3_script_5 = Python3Script(mesh=cluster_3)  # -> out, lines, beam_pairs
# ---------- python_3_script_5: Python ----------
import os
import sys
import Rhino.Geometry as rg
import rhinoscriptsyntax as rs

_gh_path = ghenv.Component.OnPingDocument().FilePath
_gh_dir = os.path.dirname(_gh_path)
_this_dir = os.path.join(_gh_dir, "reciprocal_from_mesh")

if _this_dir not in sys.path:
    sys.path.insert(0, _gh_dir)
    sys.path.insert(0, _this_dir)

import importlib
import core_graph
importlib.reload(core_graph)

from core_graph import ReciprocalFrame
from compas_rhino.conversions import mesh_to_compas
from compas.itertools import remap_values

# ============ GRASSHOPPER MAIN ============

if 'mesh' in dir() and mesh:
    if mesh:
        rhino_geo = rs.coercemesh(mesh)
        if isinstance(rhino_geo, rg.Mesh):
            mesh = mesh_to_compas(rhino_geo)
        else:
            mesh = mesh
    
    fc = [mesh.face_centroid(fkey).z for fkey in mesh.faces()]

    max_fc = max(fc)
    # Fix xi here:
    for fkey in list(mesh.faces()):
        mesh.face_attributes(fkey)["xi"] = (mesh.face_centroid(fkey)[2]/ max_fc)

    wt, we, wf, ws = 1.0, 0.3, 0.1, 0.0
    rf = ReciprocalFrame.from_mesh(mesh)  # Build graph only
    solver_info = rf.solve(weights=(wt, we, wf, ws))  # Then solve

    lines = rf.to_lines()

print(solver_info)

beam_pairs = []
for u, v in rf.edges():
    # Get the COMPAS Line object for each beam in the connection
    beam1 = rf.get_beam(u)
    beam2 = rf.get_beam(v)
    
    beam_pairs.append([beam1, beam2])

from ghpythonlib.treehelpers import list_to_tree

beam_pairs = list_to_tree(beam_pairs)
# ---------- end python_3_script_5 ----------
mesh_edges_3 = MeshEdges(Mesh=cluster_3)  # -> AllE, NakedE
compas_draw_5 = COMPASDraw(cg=python_3_script_4.lines)  # -> rg; same code as compas_draw
compas_draw_6 = COMPASDraw(cg=python_3_script_5.lines)  # -> rg; same code as compas_draw
panel = Panel(python_3_script_4.out)
panel_2 = Panel(python_3_script_5.out)
custom_preview_lineweights = CustomPreviewLineweights(
    Geometry=compas_draw_5,
    Shader=ColourSwatch(SwatchColor=RGB(255, 0, 238)),
    Thickness=Slider(3, range=0..10),
    Absolute=False)
custom_preview_lineweights_2 = CustomPreviewLineweights(
    Geometry=mesh_edges_2.AllE,
    Shader=ColourSwatch(SwatchColor=RGB(46, 46, 46)),
    Thickness=Slider(2.8, range=0..10),
    Absolute=False)
custom_preview_lineweights_3 = CustomPreviewLineweights(
    Geometry=compas_draw_6,
    Shader=ColourSwatch(SwatchColor=RGB(0, 17, 255)),
    Thickness=Slider(3, range=0..10),
    Absolute=False)
custom_preview_lineweights_4 = CustomPreviewLineweights(
    Geometry=mesh_edges_3.AllE,
    Shader=ColourSwatch(SwatchColor=RGB(186, 186, 186)),
    Thickness=Slider(1.1, range=0..10),
    Absolute=False)

# ==== cluster Cluster
tree = ClusterInput()
clean_tree = CleanTree(RemoveNulls=True, RemoveInvalid=True, RemoveEmpty=invert(False), Tree=tree)
list_item = ListItem(List=clean_tree, Index=0, Wrap=True)
i = ClusterOutput(list_item)

# ==== cluster Cluster_2
list = ClusterInput()
curve = ClusterInput()
point_on_curve = PointOnCurve(list, parameter=0.5)
point_in_curve = PointInCurve(Point=point_on_curve, Curve=curve)  # -> Relationship, Point

equality = Equality(FirstNumber=point_in_curve.Relationship, SecondNumber="0")  # -> Equality, Inequality

cull_pattern = CullPattern(List=list, CullPattern=equality.Equality)
list_2 = ClusterOutput(cull_pattern)

# ==== cluster Cluster_3
curve = ClusterInput()
explode = Explode(Curve=curve, Recursive=True)  # -> Segments, Vertices
cull_pattern = CullPattern(List=explode.Segments, CullPattern=invert([False, True]))
list_item = ListItem(List=cull_pattern, Index=0, Wrap=True)  # -> Item, Item1
flip_curve = FlipCurve(Curve=list_item.Item1)  # -> Curve, Flag
i = ClusterOutput(list_item.Item)
curve_2 = ClusterOutput(flip_curve.Curve)
